# Grasshopper definition topoSample.gh (Grasshopper 1.0.7)
# plug-ins: topoBuilding, topoGraphy, topoROK, topoStreet, topoRiver, topoSmooth, topoContour

# Copy and Paste the SHP File Path:
# 
# Please copy and paste the path of the folder containing the SHP files.
# 
# Multiple files can be selected, but they must all be from contiguous terrain areas.
# 
# Example: (B010)_DigitalMap_~~~ folder
panel = Panel(""""C:\Users\[username]\topoKorea\(B010)수치지도_35913034_2023_00000477570981"
"C:\Users\[username]\topoKorea\(B010)수치지도_35913033_2023_00000400098407"
""")
toposhp = TopoSHP(SHPFolder=panel)  # -> TopoLines, TopoLinesZ, BuildingLines, BuildingLinesZ, StreetLines, WaterLines, ParkPoints, ShapefileDictionary
# Generates terrain.
topography = TopoGraphy(TerrainLines=toposhp.TopoLines, TerrainLinesZ=toposhp.TopoLinesZ, Resolution=Slider(5, range=0..100), Run=Toggle(False))
# Terrain Generation:
# 
# Generates a smooth mesh and a bounding box.
toposmooth = TopoSmooth(TopoSurface=topography, Run=Toggle(False))  # -> TopoBox, TopoBoxMesh
# Building Generation:
# 
# "flat" -> Creates flat masses.
# "parapet" -> Creates masses with parapets.
# "removeUnderArea" -> Excludes areas smaller than 50 square meters.
topobuilding = TopoBuilding(
    TopoSurface=topography,
    BuildingLines=toposhp.BuildingLines,
    BuildingLinesZ=toposhp.BuildingLinesZ,
    BuildingType="parapet",
    RemoveUnderArea=Slider(50, range=0..100),
    Run=Toggle(False))
# Road Generation:
# 
# Generates road elements.
topostreet = TopoStreet(TopoSurface=topography, StreetLines=toposhp.StreetLines, Run=Toggle(False))  # -> StreetCurve, StreetFlatCurve
# River Generation:
# 
# Generates river elements.
topowater = TopoWater(TopoSurface=topography, WaterLine=toposhp.WaterLines, Run=Toggle(False))  # -> WaterCurve, WaterFlatCurve, WaterSurface

# ----
# Terrain Contouring:
# 
# Creates terrain contours at intervals specified by zInterval.
# 
# Estimated completion time based on contour intervals:
# 
# 1m interval -> Approximately 20 minutes
# 2m interval -> Approximately 15 minutes
# 3m interval -> Approximately 10 minutes
# Other intervals -> Within 10 minutes
# 주의!
# Recommendation:
# 
# For better results, it's recommended to use the cropped terrain surface in TS.
number_slider = Slider(3, range=0..10)
topocontour = TopoContour(ZInterval=number_slider, Run=Toggle(False))  # -> ContourCurve, ContourBrep

geo = Geometry(topocontour.ContourBrep)
